# Dynamo graph Extrae_elementos_dentro_de_los_ROOMS_Dectavinculos.dyn (Dynamo 2.16.2.5624)

select_model_element = DSModelElementSelection()  # 1 picked in the model
python_script = Python(IN[0]=select_model_element)  # CPython3
# ---------- python_script.python (117 lines) ----------
import clr
clr.AddReference('RevitAPI')
from Autodesk.Revit.DB import *
from Autodesk.Revit.DB.Architecture import Room
clr.AddReference('RevitServices')
from RevitServices.Persistence import DocumentManager

doc = DocumentManager.Instance.CurrentDBDocument

# Asegurarse de que estamos desempaquetando correctamente los elementos
room_input = UnwrapElement(IN[0])

# Verificar si el room_input es una lista
if isinstance(room_input, list):
    if len(room_input) > 0:
        room = room_input[0]
    else:
        room = None
else:
    room = room_input

# Inicializar resultados
elements_in_room = []

# Verificar si el room es None
if room is None:
    elements_in_room.append("No room was selected.")
else:
    # Verificar si el elemento es un Room de Revit
    if isinstance(room, Room):
        try:
            # Obtener el BoundingBox del Room
            room_bbox = room.get_BoundingBox(doc.ActiveView)
            
            if room_bbox is None:
                elements_in_room.append("Room does not have a bounding box in the active view.")
            else:
                # Obtener todos los elementos en la vista actual
                collector = FilteredElementCollector(doc, doc.ActiveView.Id).WhereElementIsNotElementType()

                # Tipos de elementos que representan objetos modelados, excluyendo puertas, ventanas y modelos genéricos
                exclude_categories = [
                    BuiltInCategory.OST_Doors,
                    BuiltInCategory.OST_Windows,
                    BuiltInCategory.OST_GenericModel
                ]

                include_categories = [
                    BuiltInCategory.OST_Furniture,
                    BuiltInCategory.OST_SpecialityEquipment,
                    BuiltInCategory.OST_Casework,
                    BuiltInCategory.OST_MechanicalEquipment,
                    BuiltInCategory.OST_PlumbingFixtures,
                    BuiltInCategory.OST_LightingFixtures,
                    BuiltInCategory.OST_ElectricalEquipment,
                    BuiltInCategory.OST_PipeAccessory,
                    BuiltInCategory.OST_PipeFitting,
                    BuiltInCategory.OST_PipeCurves,
                    BuiltInCategory.OST_DuctAccessory,
                    BuiltInCategory.OST_DuctFitting,
                    BuiltInCategory.OST_DuctCurves
                    # Agrega más categorías si es necesario
                ]

                # Verificar la intersección entre el bounding box del room y los bounding boxes de los elementos
                for element in collector:
                    if element.Category is None or element.Category.Id.IntegerValue in [int(cat) for cat in exclude_categories]:
                        continue
                    if element.Category.Id.IntegerValue not in [int(cat) for cat in include_categories]:
                        continue

                    element_bbox = element.get_BoundingBox(doc.ActiveView)
                    if element_bbox is None:
                        continue
                    if (element_bbox.Min.X <= room_bbox.Max.X and element_bbox.Max.X >= room_bbox.Min.X and
                        element_bbox.Min.Y <= room_bbox.Max.Y and element_bbox.Max.Y >= room_bbox.Min.Y and
                        element_bbox.Min.Z <= room_bbox.Max.Z and element_bbox.Max.Z >= room_bbox.Min.Z):
                        elements_in_room.append(element)

                # Obtener todos los RevitLinkInstances en el documento
                link_instances = FilteredElementCollector(doc).OfClass(RevitLinkInstance)

                for link_instance in link_instances:
                    # Obtener el documento vinculado
                    link_doc = link_instance.GetLinkDocument()

                    if link_doc:
                        # Obtener todos los elementos en el documento vinculado
                        linked_collector = FilteredElementCollector(link_doc).WhereElementIsNotElementType()

                        for linked_element in linked_collector:
                            if linked_element.Category is None or linked_element.Category.Id.IntegerValue in [int(cat) for cat in exclude_categories]:
                                continue
                            if linked_element.Category.Id.IntegerValue not in [int(cat) for cat in include_categories]:
                                continue

                            linked_bbox = linked_element.get_BoundingBox(None)
                            if linked_bbox is None:
                                continue
                            # Transformar el BoundingBox del elemento vinculado a las coordenadas del modelo principal
                            transform = link_instance.GetTransform()
                            transformed_min = transform.OfPoint(linked_bbox.Min)
                            transformed_max = transform.OfPoint(linked_bbox.Max)
                            transformed_bbox = BoundingBoxXYZ()
                            transformed_bbox.Min = transformed_min
                            transformed_bbox.Max = transformed_max
                            if (transformed_bbox.Min.X <= room_bbox.Max.X and transformed_bbox.Max.X >= room_bbox.Min.X and
                                transformed_bbox.Min.Y <= room_bbox.Max.Y and transformed_bbox.Max.Y >= room_bbox.Min.Y and
                                transformed_bbox.Min.Z <= room_bbox.Max.Z and transformed_bbox.Max.Z >= room_bbox.Min.Z):
                                elements_in_room.append(linked_element)

        except Exception as e:
            elements_in_room.append("Error in obtaining room bounding box: {}".format(str(e)))
    else:
        elements_in_room.append("Selected element is not a Revit Room")

OUT = elements_in_room
# ----------------------------------------
geometry = Element.Geometry(element=python_script)
watch = Watch(python_script)
