# Dynamo graph Extrae_elementos_dentro_de_los_ROOMS_VINCULADOS.dyn (Dynamo 2.16.2.5624)

python_script = Python()  # CPython3; unwired: IN[0]
# ---------- python_script.python (52 lines) ----------
import clr
clr.AddReference('RevitAPI')
clr.AddReference('RevitServices')
from Autodesk.Revit.DB import *
from RevitServices.Persistence import DocumentManager

doc = DocumentManager.Instance.CurrentDBDocument

# Obtener la vista activa
active_view = doc.ActiveView

# Obtener todas las instancias de vínculos en la vista activa
link_instances = FilteredElementCollector(doc, active_view.Id).OfClass(RevitLinkInstance)

# Inicializar resultados
rooms_in_link = []

for link_instance in link_instances:
    try:
        # Obtener el documento vinculado
        link_doc = link_instance.GetLinkDocument()
        if link_doc:
            # Obtener la transformación del vínculo
            transform = link_instance.GetTransform()
            
            # Obtener todos los `Rooms` en el documento vinculado
            room_collector = FilteredElementCollector(link_doc).OfCategory(BuiltInCategory.OST_Rooms).WhereElementIsNotElementType()
            
            for room in room_collector:
                try:
                    room_id = room.Id
                    room_name = room.get_Parameter(BuiltInParameter.ROOM_NAME).AsString()
                    
                    # Obtener la ubicación del Room
                    location = room.Location
                    if not isinstance(location, LocationPoint):
                        continue
                    
                    point = location.Point
                    transformed_point = transform.OfPoint(point)
                    
                    # Agregar room a la lista con su ID y transform
                    rooms_in_link.append((room, room_name, (transformed_point.X, transformed_point.Y, transformed_point.Z)))
                except Exception as e:
                    rooms_in_link.append(f"Error processing room ID {room.Id}: {e}")
    except Exception as e:
        rooms_in_link.append(f"Error processing link instance: {e}")

# Extraer solo los elementos Room para el nodo de geometría
rooms = [room[0] for room in rooms_in_link]

OUT = rooms
# ----------------------------------------
string = StringInput("DUCTO HVAC")
python_script_2 = Python(IN[0]=python_script, IN[1]=string)  # CPython3
# ---------- python_script_2.python (83 lines) ----------
import clr
clr.AddReference('RevitAPI')
clr.AddReference('RevitServices')
from Autodesk.Revit.DB import *
from RevitServices.Persistence import DocumentManager

# Obtener inputs
rooms = UnwrapElement(IN[0])  # Lista de rooms extraídos
target_room_name = IN[1]      # Nombre del room objetivo

doc = DocumentManager.Instance.CurrentDBDocument
active_view = doc.ActiveView

# Inicializar resultados
matching_rooms = []
elements_in_rooms = []

# Asegurarse de que target_room_name es una cadena
if not isinstance(target_room_name, str):
    OUT = "El nombre del room objetivo debe ser una cadena."
else:
    # Buscar los rooms que coincidan con el nombre objetivo
    for room in rooms:
        if room.get_Parameter(BuiltInParameter.ROOM_NAME).AsString() == target_room_name:
            matching_rooms.append(room)

    # Obtener todos los elementos modelados en la vista actual
    include_categories = [
        BuiltInCategory.OST_Furniture,
        BuiltInCategory.OST_GenericModel,
        BuiltInCategory.OST_SpecialityEquipment,
        BuiltInCategory.OST_Casework,
        BuiltInCategory.OST_Doors,
        BuiltInCategory.OST_Windows,
        BuiltInCategory.OST_MechanicalEquipment,
        BuiltInCategory.OST_PlumbingFixtures,
        BuiltInCategory.OST_LightingFixtures,
        BuiltInCategory.OST_ElectricalEquipment,
        BuiltInCategory.OST_PipeAccessory,
        BuiltInCategory.OST_PipeFitting,
        BuiltInCategory.OST_PipeCurves,
        BuiltInCategory.OST_DuctAccessory,
        BuiltInCategory.OST_DuctFitting,
        BuiltInCategory.OST_DuctCurves
        # Agrega más categorías si es necesario
    ]

    collector = FilteredElementCollector(doc, active_view.Id).WhereElementIsNotElementType()

    # Obtener la transformación del vínculo
    link_instances = FilteredElementCollector(doc, active_view.Id).OfClass(RevitLinkInstance)

    for room in matching_rooms:
        try:
            # Obtener la transformación del vínculo para este room
            link_instance = next((li for li in link_instances if room.Document == li.GetLinkDocument()), None)
            if link_instance:
                transform = link_instance.GetTransform()

                # Obtener la geometría del room
                room_bbox = room.get_BoundingBox(doc.ActiveView)
                if room_bbox:
                    # Transformar el bounding box del room
                    transformed_bbox = BoundingBoxXYZ()
                    transformed_bbox.Min = transform.OfPoint(room_bbox.Min)
                    transformed_bbox.Max = transform.OfPoint(room_bbox.Max)

                    for element in collector:
                        if element.Category is None or element.Category.Id.IntegerValue not in [int(cat) for cat in include_categories]:
                            continue
                        try:
                            element_bbox = element.get_BoundingBox(doc.ActiveView)
                            if element_bbox:
                                if (element_bbox.Min.X <= transformed_bbox.Max.X and element_bbox.Max.X >= transformed_bbox.Min.X and
                                    element_bbox.Min.Y <= transformed_bbox.Max.Y and element_bbox.Max.Y >= transformed_bbox.Min.Y and
                                    element_bbox.Min.Z <= transformed_bbox.Max.Z and element_bbox.Max.Z >= transformed_bbox.Min.Z):
                                    elements_in_rooms.append(element)
                        except Exception as e:
                            elements_in_rooms.append(f"Error processing element ID {element.Id}: {e}")
        except Exception as e:
            elements_in_rooms.append(f"Error processing room bounding box: {e}")

OUT = elements_in_rooms
# ----------------------------------------
string_2 = StringInput("YASER SANCHEZ")
python_script_3 = Python(IN[0]=python_script_2, IN[1]=string_2)  # CPython3
# ---------- python_script_3.python (34 lines) ----------
import clr
clr.AddReference('RevitAPI')
clr.AddReference('RevitServices')
from Autodesk.Revit.DB import *
from RevitServices.Persistence import DocumentManager
from RevitServices.Transactions import TransactionManager

# Obtener inputs
elements = UnwrapElement(IN[0])  # Lista de elementos extraídos
comment = IN[1]  # Comentario a insertar en los elementos

doc = DocumentManager.Instance.CurrentDBDocument

# Iniciar transacción
TransactionManager.Instance.EnsureInTransaction(doc)

for element in elements:
    try:
        # Obtener el parámetro "Comentarios"
        comment_param = element.LookupParameter("Comentarios")
        
        if comment_param is not None and comment_param.StorageType == StorageType.String:
            # Asignar el comentario
            comment_param.Set(comment)
        else:
            OUT = f"El elemento con ID {element.Id} no tiene el parámetro 'Comentarios' o el tipo de almacenamiento no es String."
    
    except Exception as e:
        OUT = f"Error procesando el elemento con ID {element.Id}: {e}"

# Finalizar transacción
TransactionManager.Instance.TransactionTaskDone()

OUT = "Comentarios agregados correctamente."
# ----------------------------------------
