# Dynamo graph Extrae_elementos_dentro_de_los_ROOMS_y_completa_parametros_segun_su_nombre.dyn (Dynamo 2.16.2.5624)

select_model_element = DSModelElementSelection()  # 1 picked in the model
python_script = Python(IN[0]=select_model_element)  # CPython3
# ---------- python_script.python (79 lines) ----------
import clr
clr.AddReference('RevitAPI')
from Autodesk.Revit.DB import *
from Autodesk.Revit.DB.Architecture import Room
clr.AddReference('RevitServices')
from RevitServices.Persistence import DocumentManager

doc = DocumentManager.Instance.CurrentDBDocument

# Asegurarse de que estamos desempaquetando correctamente los elementos
room_input = UnwrapElement(IN[0])

# Verificar si el room_input es una lista
if isinstance(room_input, list):
    if len(room_input) > 0:
        room = room_input[0]
    else:
        room = None
else:
    room = room_input

# Inicializar resultados
elements_in_room = []

# Verificar si el room es None
if room is None:
    elements_in_room.append("No room was selected.")
else:
    # Verificar si el elemento es un Room de Revit
    if isinstance(room, Room):
        try:
            # Obtener el BoundingBox del Room
            room_bbox = room.get_BoundingBox(doc.ActiveView)
            
            if room_bbox is None:
                elements_in_room.append("Room does not have a bounding box in the active view.")
            else:
                # Obtener todos los elementos en la vista actual
                collector = FilteredElementCollector(doc, doc.ActiveView.Id).WhereElementIsNotElementType()

                # Tipos de elementos que representan objetos modelados
                include_categories = [
                    BuiltInCategory.OST_Furniture,
                    BuiltInCategory.OST_GenericModel,
                    BuiltInCategory.OST_SpecialityEquipment,
                    BuiltInCategory.OST_Casework,
                    BuiltInCategory.OST_Doors,
                    BuiltInCategory.OST_Windows,
                    BuiltInCategory.OST_MechanicalEquipment,
                    BuiltInCategory.OST_PlumbingFixtures,
                    BuiltInCategory.OST_LightingFixtures,
                    BuiltInCategory.OST_ElectricalEquipment,
                    BuiltInCategory.OST_PipeAccessory,
                    BuiltInCategory.OST_PipeFitting,
                    BuiltInCategory.OST_PipeCurves,
                    BuiltInCategory.OST_DuctAccessory,
                    BuiltInCategory.OST_DuctFitting,
                    BuiltInCategory.OST_DuctCurves
                    # Agrega más categorías si es necesario
                ]

                # Verificar la intersección entre el bounding box del room y los bounding boxes de los elementos
                for element in collector:
                    if element.Category is None or element.Category.Id.IntegerValue not in [int(cat) for cat in include_categories]:
                        continue

                    element_bbox = element.get_BoundingBox(doc.ActiveView)
                    if element_bbox is None:
                        continue
                    if (element_bbox.Min.X <= room_bbox.Max.X and element_bbox.Max.X >= room_bbox.Min.X and
                        element_bbox.Min.Y <= room_bbox.Max.Y and element_bbox.Max.Y >= room_bbox.Min.Y and
                        element_bbox.Min.Z <= room_bbox.Max.Z and element_bbox.Max.Z >= room_bbox.Min.Z):
                        elements_in_room.append(element)
        except Exception as e:
            elements_in_room.append("Error in obtaining room bounding box: {}".format(str(e)))
    else:
        elements_in_room.append("Selected element is not a Revit Room")

OUT = elements_in_room
# ----------------------------------------
string = StringInput("Comentarios")
python_script_2 = Python(IN[0]=select_model_element)  # CPython3
# ---------- python_script_2.python (21 lines) ----------
import clr
clr.AddReference('RevitAPI')
clr.AddReference('RevitServices')
from Autodesk.Revit.DB import *
from Autodesk.Revit.DB.Architecture import Room
from RevitServices.Persistence import DocumentManager

# Obtener el documento actual de Revit
doc = DocumentManager.Instance.CurrentDBDocument

# Obtener el elemento de entrada
room = UnwrapElement(IN[0])

# Obtener el parámetro incorporado "ROOM_NAME"
param = room.get_Parameter(BuiltInParameter.ROOM_NAME)

# Obtener el nombre del Room si el parámetro existe
room_name = param.AsString() if param else "BuiltInParameter 'ROOM_NAME' not found"

# Devolver el nombre del Room
OUT = room_name
# ----------------------------------------
python_script_3 = Python(IN[0]=python_script, IN[1]=string, IN[2]=python_script_2)  # CPython3
# ---------- python_script_3.python (47 lines) ----------
import clr
clr.AddReference('RevitAPI')
clr.AddReference('RevitServices')
from Autodesk.Revit.DB import *
from RevitServices.Persistence import DocumentManager
from RevitServices.Transactions import TransactionManager

# Obtener el documento actual de Revit
doc = DocumentManager.Instance.CurrentDBDocument

# Obtener los elementos de entrada (resultados del script anterior)
elements = UnwrapElement(IN[0])

# El nombre del parámetro que deseas actualizar
param_name = IN[1]

# El nuevo valor que deseas establecer en el parámetro
new_value = IN[2]

# Iniciar una transacción en Revit
TransactionManager.Instance.EnsureInTransaction(doc)

# Actualizar el parámetro especificado de cada elemento
for element in elements:
    try:
        param = element.LookupParameter(param_name)
        if param is not None:
            # Determinar el tipo de almacenamiento del parámetro y establecer el valor adecuadamente
            if param.StorageType == StorageType.String:
                param.Set(new_value)
            elif param.StorageType == StorageType.Integer:
                param.Set(int(new_value))
            elif param.StorageType == StorageType.Double:
                param.Set(float(new_value))
            elif param.StorageType == StorageType.ElementId:
                param.Set(ElementId(int(new_value)))
        else:
            OUT.append("Parameter '{}' not found in element ID {}".format(param_name, element.Id))
    except Exception as e:
        # En caso de error, agregar el mensaje de error a los resultados
        OUT.append("Error updating element ID {}: {}".format(element.Id, str(e)))

# Finalizar la transacción
TransactionManager.Instance.TransactionTaskDone()

# Devolver los elementos actualizados
OUT = elements
# ----------------------------------------
